# Grasshopper definition 0.0_Panelize_SurfaceSubdivisionTools.gh (Grasshopper 1.0.7)
# plug-ins: Ankylosaurus

# ---- group: Input-BASE SRF FLAT
# BASIC SUB DIVISION
srf = Surface(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)

# ---- group: Input-BASE SRF CURVED
# alanncation@gmail.com
# 
# These are surface subdivision components meant to give the user greater control over what they are subdividing. Numeric inputs allow for dynamic subdivisions of various surfaces.
srf_2 = Surface(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)

# NUMERIC SUBDIVISION  FLAT SURFACE
srf_3 = Surface(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)

# NUMERIC SUBDIVISION CURVED SURFACE
srf_4 = Surface(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)

# ----
number_slider = Slider(12, range=0..100)
number_slider_2 = Slider(20, range=0..100)
stagqsubd = StaggeredQuadSubD(Surface=srf_2, U=number_slider, V=number_slider_2)
diamonds = DiamondSubdivide(Surface=srf_2, U=number_slider, V=number_slider_2)  # -> Diamonds, Triangles

# ---- group: ANKYLOSAURUS QUADS
subdivq = QuadSubdivideSurface(Surface=srf, U=Slider(18, range=0..100), V=Slider(5, range=0..10))

subdivq_2 = QuadSubdivideSurface(Surface=srf_2, U=number_slider, V=number_slider_2)

# ---- group: Output-SRF PANELS
srf_5 = Surface(subdivq_2)

srf_6 = Surface(stagqsubd)

srf_7 = Surface([diamonds.Diamonds, diamonds.Triangles])

# ----
list = ValueList({"Quad Panels": 0, "Staggered Panels": 1, "Diamond Panels": 2}, selected="Staggered Panels")
filter = StreamFilter(Gate=list, Stream0=srf_5, Stream1=srf_6, Stream2=srf_7)
list_2 = ValueList({"Quad Panels": 0, "Staggered Panels": 1, "Diamond Panels": 2}, selected="Diamond Panels")
list_3 = ValueList({"Quad Panels": 0, "Staggered Panels": 1, "Diamond Panels": 2}, selected="Diamond Panels")

# ---- group: Output-SRF PANELS
srf_8 = Surface(subdivq)

# ---- group: Output-SRF: SMOOTH PANELS
srf_9 = Surface(filter)

# ---- group: Smooth or Rationalized?
list_4 = ValueList({"Smooth Panels": 0, "Rationalized Panels": 1}, selected="Rationalized Panels")

# ----
pt = ConstructPoint(XCoordinate=Slider(0, range=0..1), YCoordinate=Slider(0, range=0..1), ZCoordinate=0)

# ---- group: Create Dynamic Panel Domains
# Graph Mapper Notes: Playing with the "graph mapper" will result in different affects. You can also right-click the component and change graph types to experiment with different panel results.
number_slider_3 = Slider(33, range=0..100)
range = Range(Domain=Domain(0, 1), Steps=number_slider_3)
range_2 = Range(Domain=Domain(0, 1), Steps=Slider(22, range=0..100))
graph = GraphMapper(
    range,
    x0=0,
    x1=1,
    y0=0,
    y1=1,
    container_name="Bezier",
    cpx=[0, 0.2271238416, 0.3494748175, 1],
    cpy=[0, 0.7085455656, 0.8880758286, 1])
graph_2 = GraphMapper(
    range_2,
    x0=0,
    x1=1,
    y0=0,
    y1=1,
    container_name="Bezier",
    cpx=[0, 0.3343069255, 0.8242338896, 1],
    cpy=[0, 0.5318182707, 0.2396970987, 1])

# ----
num = Number(graph_2)
num_2 = Number(graph)

# ---- group: Create Dynamic Panel Domains / ANKYLOSAURUS NUMBER SUBDIVIDE
numsdivq = NumericQuadSubdivide(Surface=reparameterize(srf_3), NumbersU=num_2, NumbersV=num)

# ---- group: Create Dynamic Panel Domains (continued)
numstagsubd = StaggeredQuadNumeric(Surface=reparameterize(srf_3), NumbersU=num_2, NumbersV=num)
dianum = DiamondSubdivideNumeric(Surface=srf_3, NumbersU=num_2, NumbersV=num)  # -> Diamonds, Triangles

# ---- group: Output-SRF: SMOOTH PANELS
srf_10 = Surface(numsdivq)

srf_11 = Surface(numstagsubd)

# ---- group: Output-SRF: DIAMOND PANELS
srf_12 = Surface([dianum.Diamonds, dianum.Triangles])

# ----
filter_2 = StreamFilter(Gate=list_3, Stream0=srf_10, Stream1=srf_11, Stream2=srf_12)

# ---- group: Output-SRF: SMOOTH PANELS
srf_13 = Surface(filter_2)

# ---- group: Create Dynamic Panel Domains
# Graph Mapper Notes: Playing with the "graph mapper" will result in different affects. You can also right-click the component and change graph types to experiment with different panel results.
number_slider_4 = Slider(45, range=0..100)
number_slider_5 = Slider(33, range=0..100)
range_3 = Range(Domain=Domain(0, 1), Steps=number_slider_4)
range_4 = Range(Domain=Domain(0, 1), Steps=number_slider_5)
graph_3 = GraphMapper(
    range_3,
    x0=0,
    x1=1,
    y0=0,
    y1=1,
    container_name="Bezier",
    cpx=[0, 0.1774795353, 0.3264614642, 1],
    cpy=[0, 0.6017012596, 0.837000072, 1])
graph_4 = GraphMapper(
    range_4,
    x0=0,
    x1=1,
    y0=0,
    y1=1,
    container_name="Bezier",
    cpx=[0, 0.7151075006, 0.2940727174, 1],
    cpy=[0, 0.08761692047, 0.9615820646, 1])

# ----
num_3 = Number(graph_3)
num_4 = Number(graph_4)

# ---- group: Create Dynamic Panel Domains (continued)
sdivnums = DivideSurfaceNumeric(Surface=reparameterize(srf_4), NumbersU=num_3, NumbersV=num_4)  # -> Points, Normals, Parameters
numstagsubd_2 = StaggeredQuadNumeric(Surface=reparameterize(srf_4), NumbersU=num_3, NumbersV=num_4)
diafrompts = DiamondsFromPoints(Points=flatten(sdivnums.Points), U=number_slider_4, V=number_slider_5)  # -> Diamonds, Triangles
dianum_2 = DiamondSubdivideNumeric(Surface=srf_4, NumbersU=num_3, NumbersV=num_4)  # -> Diamonds, Triangles

# ---- group: Create Dynamic Panel Domains / ANKYLOSAURUS NUMBER SUBDIVIDE
numsdivq_2 = NumericQuadSubdivide(Surface=reparameterize(srf_4), NumbersU=num_3, NumbersV=num_4)

# ---- group: Output-SRF: SMOOTH PANELS
srf_14 = Surface(numsdivq_2)

srf_15 = Surface(numstagsubd_2)

# ---- group: Output-SRF: DIAMOND PANELS
srf_16 = Surface([dianum_2.Diamonds, dianum_2.Triangles])

srf_17 = Surface(diafrompts.Diamonds)

# ----
filter_3 = StreamFilter(Gate=list_2, Stream0=srf_14, Stream1=srf_15, Stream2=srf_16)

# ---- group: Output-SRF: SMOOTH PANELS
srf_18 = Surface(filter_3)

# ---- group: ANKYLOSAURUS: Rationalizes Surface to flat Quads
srat = SurfaceRationalize(SurfacePanels=srf_18, Planarize=Toggle(True), UVParameter=pt)

# ----
filter_4 = StreamFilter(Gate=list_4, Stream0=srf_18, Stream1=srat)

# ---- group: Output-SRF
srf_19 = Surface(filter_4)
