# Grasshopper definition 0.1_Panelize_SurfaceSubdivisionWithInputGeometry.gh (Grasshopper 1.0.7)
# plug-ins: Ankylosaurus

# ---- group: Input-BASE SRF
srf = Surface(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)

# ---- group: Column Grid
crv = Curve([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])

# ---- group: Floor Surfaces
# alanncation@gmail.com
# 
# These subdivision components give the user greater control over what they are subdividing. Curve and Point inputs allow for dynamic and specified control over subdivisions of various surfaces.
srf_2 = Surface([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])

# ---- group: Input-BASE BREP
brep = Brep([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])

# ---- group: Column Grid
crv_2 = Curve([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])

# ---- group: Floor Surfaces
srf_3 = Surface([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])

# ---- group: Input Srf
srf_4 = Surface(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)

# POINT INPUT SUBDIVISION  -  RANDOM POINTS
srf_5 = Surface(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)

# POINT INPUT SUBDIVISION  -  RANDOM POINTS 2
srf_6 = Surface(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)

# ---- group: Single Surface / Input-BASE SRF
# CURVE SUBDIVIDE SURFACE
srf_7 = Surface(srf)

# ---- group: Single Surface / Column Grid
crv_3 = Curve(crv)

# ---- group: Single Surface / Floor Surfaces
srf_8 = Surface(srf_2)

# ---- group: Input-BASE BREP
# CURVE SUBDIV MULTIPLE SURFACES   -   BAD
brep_2 = Brep(brep)

# ---- group: Column Grid
crv_4 = Curve(crv_2)

# ---- group: Floor Surfaces
# CURVE SUBDIV MULTIPLE SURFACES - GOOD
srf_9 = Surface(srf_3)

# ---- group: Input-BASE BREP
brep_3 = Brep(brep)

# ---- group: Column Grid
crv_5 = Curve(crv_2)

# ---- group: Floor Surfaces
srf_10 = Surface(srf_3)

# ---- group: Basic Subdivision
# Works Fine but subdivision can be uneven because it is basing it off of the UV values of the surface. Using inputs like Points can help us add specificity to the subdivions
number_slider = Slider(25, range=0..100)
# POINT INPUT SUBDIVISION
number_slider_2 = Slider(25, range=0..100)
stagqsubd = StaggeredQuadSubD(Surface=srf_4, U=number_slider, V=number_slider_2)

# ----
X = UnitX(Factor=1)
seppline = SeparateSegmentsByDirection(Polyline=srf_4, Vector=X, Tolerance=Slider(0.5, range=0..1))  # -> CurveA, CurveB
item = ListItem(List=seppline.CurveA, Index=0, Wrap=True)
item_2 = ListItem(List=seppline.CurveB, Index=0, Wrap=True)
contour = Contour(Curve=item_2, Point=Point(0, 0, 0), Direction=Vector(0, 0, 1), Distance=Slider(6.66, range=0..10))  # -> flatten(Contours), Parameters
crvtargdist = DivideCrvByTargetDistance(Curve=item, TargetDistance=Slider(6, range=0..10), CutoffTolerance=0.001)
srf_11 = Surface(srf_4)
pt = Point(crvtargdist)
pt_2 = Point(contour.Contours)
ptsdivq = QuadSubdividePoints(Surface=srf_11, IntersectionPointsU=pt, IntersectionPointsV=pt_2)
ptsdivstag = StaggeredQuadSubdividePoints(Surface=srf_11, IntersectionPointsU=pt, IntersectionPointsV=pt_2)
diapts = DiamondSubdividePoints(Surface=srf_11, IntersectionPointsU=pt, IntersectionPointsV=pt_2)  # -> SurfacePanels, Triangles

X_2 = UnitX(Factor=1)
seppline_2 = SeparateSegmentsByDirection(Polyline=srf_5, Vector=X_2, Tolerance=Slider(0.5, range=0..1))  # -> CurveA, CurveB
item_3 = ListItem(List=seppline_2.CurveA, Index=0, Wrap=True)
item_4 = ListItem(List=seppline_2.CurveB, Index=0, Wrap=True)
popgeo = PopulateGeometry(Geometry=item_3, Count=Slider(30, range=0..100), Seed=Slider(244, range=0..1000))
popgeo_2 = PopulateGeometry(Geometry=item_4, Count=Slider(20, range=0..100), Seed=Slider(554, range=0..1000))
srf_12 = Surface(srf_5)
pt_3 = Point(popgeo)
pt_4 = Point(popgeo_2)
ptsdivq_2 = QuadSubdividePoints(Surface=srf_12, IntersectionPointsU=pt_3, IntersectionPointsV=pt_4)
ptsdivstag_2 = StaggeredQuadSubdividePoints(Surface=srf_12, IntersectionPointsU=pt_3, IntersectionPointsV=pt_4)
diapts_2 = DiamondSubdividePoints(Surface=srf_12, IntersectionPointsU=pt_3, IntersectionPointsV=pt_4)  # -> SurfacePanels, Triangles

X_3 = UnitX(Factor=1)
seppline_3 = SeparateSegmentsByDirection(Polyline=srf_6, Vector=X_3, Tolerance=Slider(0.5, range=0..1))  # -> CurveA, CurveB
item_5 = ListItem(List=seppline_3.CurveB, Index=0, Wrap=True)
contour_2 = Contour(Curve=item_5, Point=Point(0, 0, 0), Direction=Vector(0, 0, 1), Distance=Slider(6.66, range=0..10))  # -> flatten(Contours), Parameters
srf_13 = Surface(srf_6)
pt_5 = Point(contour_2.Contours)
ptsdivq_3 = QuadSubdividePoints(Surface=srf_13, IntersectionPointsV=pt_5)

# ---- group: Output-SRF: SMOOTH PANELS
srf_14 = Surface(ptsdivq)

srf_15 = Surface(ptsdivstag)

# ---- group: Output-SRF: DIAMOND PANELS
srf_16 = Surface([diapts.SurfacePanels, diapts.Triangles])

# ---- group: Output-SRF: SMOOTH PANELS
srf_17 = Surface(ptsdivq_2)

srf_18 = Surface(ptsdivstag_2)

# ---- group: Output-SRF: DIAMOND PANELS
srf_19 = Surface([diapts_2.SurfacePanels, diapts_2.Triangles])

# ---- group: First Subdivision
srf_20 = Surface(ptsdivq_3)

# ----
list = ValueList({"Quad Panels": 0, "Staggered Panels": 1, "Diamond Panels": 2}, selected="Staggered Panels")
list_2 = ValueList({"Quad Panels": 0, "Staggered Panels": 1, "Diamond Panels": 2}, selected="Staggered Panels")
filter = StreamFilter(Gate=list, Stream0=srf_14, Stream1=srf_15, Stream2=srf_16)
filter_2 = StreamFilter(Gate=list_2, Stream0=srf_17, Stream1=srf_18, Stream2=srf_19)

X_4 = UnitX(Factor=1)
seppline_4 = SeparateSegmentsByDirection(Polyline=srf_20, Vector=X_4, Tolerance=Slider(0.5, range=0..1))  # -> CurveA, CurveB
item_6 = ListItem(List=seppline_4.CurveA, Index=0, Wrap=True)
crv_6 = Curve(flatten(item_6))
lng = ListLength(List=crv_6)
dom = ConstructDomain(DomainStart=Slider(15, range=0..100), DomainEnd=Slider(60, range=0..100))
rndnorpt = NonConsecutiveRandom(RandomRange=dom, Number=lng, Seed=Slider(401, range=0..1000))
divide = DivideCurve(Curve=crv_6, Count=rndnorpt, Kinks=False)  # -> Points, Tangents, Parameters

# ---- group: Output-SRF: SMOOTH PANELS
srf_21 = Surface(filter)

srf_22 = Surface(filter_2)

# ----
ptsdivq_4 = QuadSubdividePoints(Surface=graft(srf_20), IntersectionPointsU=divide.Points)

# ---- group: Output-SRF: SMOOTH PANELS
srf_23 = Surface(ptsdivq_4)

# ---- group: Single Surface
edges = BrepEdges(Brep=srf_8)  # -> flatten(Naked), Interior, NonManifold

# ---- group: Single Surface / ANKYLOSAURUS CURVE SUBDIVIDE
crvsdivq = CurveQuadSubdivide(Surface=srf_7, IntersectionCurvesU=crv_3, IntersectionCurvesV=edges.Naked)

# ---- group: Single Surface (continued)
srf_24 = Surface(crvsdivq)

# ----
srf_25 = Surface(srf_24)

# ----
# Notice how this is wrong because some of the surfaces have the wrong UV direction relative to the input curves. This is basically a bunch of garbage
debrep = DeconstructBrep(Brep=brep_2)  # -> Faces, Edges, Vertices
edges_2 = BrepEdges(Brep=srf_9)  # -> flatten(Naked), Interior, NonManifold

# ---- group: ANKYLOSAURUS CURVE SUBDIVIDE
crvsdivq_2 = CurveQuadSubdivide(Surface=debrep.Faces, IntersectionCurvesU=crv_4, IntersectionCurvesV=edges_2.Naked)

# ----
srf_26 = Surface(crvsdivq_2)

# ----
# This is where the "Unify Surface Direction" component comes in handy when dealing with multiple surfaces. This method assumes the input surfaces were modeled with no consideration of their UV parameterization
edges_3 = BrepEdges(Brep=srf_10)  # -> flatten(Naked), Interior, NonManifold
debrep_2 = DeconstructBrep(Brep=brep_3)  # -> Faces, Edges, Vertices
srf_27 = Surface(debrep_2.Faces)

# ---- group: ANKYLOSAURUS UNIFY SURFACE DIRECTION
srfunify = UnifySurfaceDirection(Surface=debrep_2.Faces, Vector=Vector(0, 0, 1), ToleranceAngle=0.1)

# ---- group: ANKYLOSAURUS CURVE SUBDIVIDE
crvsdivq_3 = CurveQuadSubdivide(Surface=srfunify, IntersectionCurvesU=crv_5, IntersectionCurvesV=edges_3.Naked)

# ----
srf_28 = Surface(crvsdivq_3)
flip = Flip(Surface=srf_28, Guide=graft(srf_27))  # -> Surface, Result

# ---- group: Compare these 2 results
srf_29 = Surface(srf_26)
srf_30 = Surface(flip.Surface)

# ---- group: Point Subdivide
seppline_5 = SeparateSegmentsByDirection(Polyline=srf_30, Vector=Vector(0, 0, 1), Tolerance=0.02)  # -> CurveA, CurveB
crv_7 = Curve(seppline_5.CurveA)
crv_8 = Curve(seppline_5.CurveB)
item_7 = ListItem(List=crv_8, Index=0, Wrap=True)
crvtargdist_2 = DivideCrvByTargetDistance(Curve=item_7, TargetDistance=Slider(6, range=0..10), CutoffTolerance=0.001)
ptsdivq_5 = QuadSubdividePoints(Surface=graft(srf_30), IntersectionPointsU=crvtargdist_2)

# ----
srf_31 = Surface(ptsdivq_5)
