# Grasshopper definition 0.2_Panelize_SubdivideBrepByGrids&Levels.gh (Grasshopper 1.0.7)
# plug-ins: Ankylosaurus, ShapeDiverForGrasshopper

# alanncation@gmail.com
# 
# This is an example of hoe you can use Ankylosaurus to subdivide a BREP massing model using input grid lines and intersecting surfaces (in this case column grids and floor plates). One advantage to this method is not needing to split the surfaces or use more computationally intense methods to panelize.
sddp = ShapeDiverDocumentPayload({AbsoluteTolerance=0, AngleTolerance=0, DistanceDisplayPrecision=0, GltfVersion="Gltf2", GrasshopperVersion="1.0.0007", InputGroups="{}", OutputGroups="{}", RelativeTolerance=0, RhinoVersion="7.37.24107.15001", UnitSystem=0, VersionCreated="1.16.0.0", VersionSaved="1.16.0.0"})

# ---- group: Input Mass
brep = Brep(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)

# ---- group: Input Column Grid
crv = Curve([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])

# ---- group: Input Floors
srf = Surface([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])

# ----
area = Area(Geometry=srf, UseTasks=True)  # -> Area, Centroid

# ---- group: Ankylosaurus - Separate Faces
brepfaces = SeparateFacesByDirection(Brep=brep, DirectionVector=Vector(0, 0, 1), Tolerance=0.1)  # -> TopFaces, BottomFaces, SideFaces

# ----
Z = UnitZ(Factor="1500")
extr = Extrude(Base=crv, Direction=Z)

# ---- group: Base Surfaces
srf_2 = Surface(brepfaces.SideFaces)

# ---- group: Ankylosaurus - Unify UVS by Vector
srfunifydir = UnifySurfaceByDirection(Surface=srf_2, Vector=Vector(0, 0, 1), ToleranceAngle=0.1)

# ----
srf_3 = Surface(srfunifydir)
srf_4 = Surface(extr)

# ---- group: Setup Division Geometry for Dividing By Grids and Floor Levels / Ankylosaurus - Separate Segments
seppline = SeparateSegmentsByDirection(Polyline=srf_3, Vector=Vector(0, 0, 1), Tolerance=0.02)  # -> CurveA, CurveB

# ---- group: Setup Division Geometry for Dividing By Grids and Floor Levels
crv_2 = Curve(seppline.CurveB)
crv_3 = Curve(seppline.CurveA)
bcx = BrepCurve(Brep=srf_4, Curve=crv_2, UseTasks=False)  # -> Curves, Points
pcx = CurvePlane(Curve=crv_3, Plane=area.Centroid, UseTasks=False)  # -> Points, ParamsC, ParamsP
pshift = ShiftPaths(Data=bcx.Points, Offset=-1)
pshift_2 = ShiftPaths(Data=pcx.Points, Offset=-1)

# ---- group: Ankylosaurus - Quad Subdivide with Pts
ptsdivq = QuadSubdividePoints(Surface=graft(srf_3), IntersectionPointsU=pshift, IntersectionPointsV=pshift_2)

# ----
srf_5 = Surface(ptsdivq)

# ---- group: Further Subdivide By Distance / Ankylosaurus - Separate Segments
seppline_2 = SeparateSegmentsByDirection(Polyline=srf_5, Vector=Vector(0, 0, 1), Tolerance=0.02)  # -> CurveA, CurveB

# ---- group: Further Subdivide By Distance
item = ListItem(List=seppline_2.CurveB, Index=0, Wrap=True)
crv_4 = Curve(item)
crvtargdist = DivideCrvByTargetDistance(Curve=crv_4, TargetDistance=Slider(8, range=0..10), CutoffTolerance=0.001)

# ----
pt = Point(crvtargdist)

# ---- group: Ankylosaurus - Quad Subdivide with Pts
ptsdivq_2 = QuadSubdividePoints(Surface=graft(srf_5), IntersectionPointsU=pt)

# ----
pshift_3 = ShiftPaths(Data=simplify(ptsdivq_2), Offset=-1)
srf_6 = Surface(pshift_3)

# ---- group: Remove Panels Not Touching Base Surfaces from Possible Trimmed Srfs / Base Surfaces
srf_7 = Surface(srf_2)

# ---- group: Remove Panels Not Touching Base Surfaces from Possible Trimmed Srfs
area_2 = Area(Geometry=srf_6)  # -> Area, Centroid
pull = PullPoint(Point=area_2.Centroid, Geometry=graft(srf_7), ClosestOnly=True)  # -> ClosestPoint, Distance
smaller = SmallerThan(FirstNumber=pull.Distance, SecondNumber=Slider(0.1, range=0..1))  # -> SmallerThan, OrEqualTo
cull = CullPattern(List=srf_6, CullPattern=smaller.SmallerThan)

# ---- group: Output Panels
srf_8 = Surface(cull)

# ----
edges = BrepEdges(Brep=srf_8)  # -> Naked, Interior, NonManifold
preview = CustomPreview(Geometry=srf_8, Material=ColourSwatch(SwatchColor=RGB(166, 166, 166)))
preview_2 = CustomPreview(Geometry=edges.Naked, Material=ColourSwatch(SwatchColor=RGB(0, 0, 0)))
