# Grasshopper definition 1.0_Util_SeparationComponents.gh (Grasshopper 1.0.7)
# plug-ins: Ankylosaurus

# ---- group: Polysurface To Extract Faces
# SEPARATE POLYSURFACE FACES
# alanncation@gmail.com
# 
# Example using various geometry separation utilities
brep = Brep([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])

# ---- group: Input Curve
# SEPARATE CURVES BY DIRECTION
crv = Curve(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)

# ---- group: Input Curves
# SEPARATE CURVES AND LINES
crv_2 = Curve([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])

# DIVIDE BY TARGET DISTANCE
# Not a separation component.... BUT Shoutout to Nick Desbiens for the methodology
crv_3 = Curve([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])

# ----
join = JoinCurves(Curves=crv_3, Preserve=False)
Y = UnitY(Factor=1)
Y_2 = UnitY(Factor=1)

# ---- group: Ankylosaurus Seperate Faces By Direction
brepfaces = SeparateFacesByDirection(Brep=brep, DirectionVector=Y, Tolerance=Slider(0.13, range=0..1))  # -> TopFaces, BottomFaces, SideFaces

# ---- group: Ankylosaurus Separate Crvs by Direction
seppline = SeparateSegmentsByDirection(Polyline=crv, Vector=Y_2, ToleranceAngle=Slider(0.06, range=0..1))  # -> CurveA, CurveB

# ----
crvsvslns = SeparateCurvesLines(Curve=crv_2, Tolerance=Slider(5, range=0..5))  # -> Curve, Line, Boolean
crvtargdist = DivideCrvByTargetDistance(Curve=join, TargetDistance=Slider(4.243, range=0..5), CutoffTolerance=0.001)

# ---- group: Distance Check
cluster = Cluster(pt=crvtargdist)

# ---- group: Check The Aproximate distance
# The distance will be withing the tolerance. If more than one number appears, then they will be within tolerance of each other interms of significant digits
num = Number(cluster)
panel = Panel(num)

# ----
crv_4 = Curve(seppline.CurveA)
crv_5 = Curve(seppline.CurveB)
crv_6 = Curve(crvsvslns.Curve)
line = Line(crvsvslns.Line)
bool = Boolean(crvsvslns.Boolean)
pt = Point(crvtargdist)
srf = Surface(brepfaces.TopFaces)
srf_2 = Surface(brepfaces.BottomFaces)
srf_3 = Surface(brepfaces.SideFaces)

# ==== cluster Cluster
pt = ClusterInput()

pt_2 = Point(pt)
pline = PolyLine(Vertices=pt_2, Closed=False)
explode = Explode(Curve=pline, Recursive=True)  # -> Segments, Vertices
len = Length(Curve=explode.Segments)
cset = CreateSet(List=len)  # -> Set, Map
num = Number(cset.Set)

num_2 = ClusterOutput(num)
