# Grasshopper definition 1.1_Util_UnifySrfUvsWithGuideSrf.gh (Grasshopper 1.0.7)
# plug-ins: Ankylosaurus

# ---- group: Input Srf
# UNIFY UVs BY GUIDE - SIMPLE EXAMPLE
# alanncation@gmail.com
# 
# Methods for using Ankylosaurus to change and unify Surface UV directions
srf = Surface(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)

# ---- group: UV Guide Srf
srf_2 = Surface(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)

# ---- group: Set Messed Up Surfaces
# UNIFY UVs BY GUIDE - AUTOMATIC EXAMPLE
# This is one example of how to automatically create guide surfaces if you have a lot of input surfaces with incorrect or inconsistent UVs
srf_3 = Surface([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])

# ---- group: WRONG UVs
stagqsubd = StaggeredQuadSubD(Surface=srf_3, U=Slider(3, range=0..10), V=Slider(5, range=0..10))

# ----
# Joining sets the normals to equal each other
join = BrepJoin(Breps=srf_3)  # -> Breps, Closed

# ---- group: Tolerance - Adjust as needed
# The Input Surface will go through the unify UV component in order to match the Guide surface UV and normal direction
# Tolerance needs to be higher if surface has a lot of curvature
number_slider = Slider(0.8, range=0..1)
num = Number(number_slider)

# ---- group: Joined Messed Up Surfaces
brep = Brep(join.Breps)

# ---- group: UV Display - See Totally Messed Up UV Directions
panel = Panel("U = red // V = green // N = blue")
cluster = Cluster(srf=srf_3, uv="0.15,0.15", vec_length=Slider(10, range=0..100))  # -> pt_2, vec_2, col_2
vdisex = VectorDisplayEx(Point=cluster.pt_2, Vector=cluster.vec_2, Colour=cluster.col_2, Width=2)

# ---- group: Create Bounding Cylinder As a Unifier Srf Guide
cluster_2 = Cluster_2(geo=brep)

# ---- group: Unify UVs with Guide Surfaces
unifybyguide = UnifyUVsByGuideSrf(Breps=graft(srf), GuideSurface=graft(srf_2), Tolerance=num)

# ---- group: Set Desired UV to Unify input UVs with
swapuv = SwapSurfaceDirection(
    Surface=cluster_2,
    FlipSurface=Toggle(True),
    SwapSurfaceDirection=Toggle(True),
    ReverseU=Toggle(False),
    ReverseV=Toggle(False))

# ---- group: Unified Surfaces
srf_4 = Surface(unifybyguide)

# ---- group: Joined Messed Up Surfaces
brep_2 = Brep(brep)

# ---- group: Tolerance - Adjust as needed
num_2 = Number(Slider(0.1, range=0..1))

# ---- group: Cylinder
srf_5 = Surface(flatten(swapuv))

# ---- group: UV Display - See Test Srf UV
cluster_3 = Cluster(srf=srf_5, uv="0.5,0.5", vec_length=Slider(10, range=0..100))  # -> pt_2, vec_2, col_2
vdisex_2 = VectorDisplayEx(Point=cluster_3.pt_2, Vector=cluster_3.vec_2, Colour=cluster_3.col_2, Width=2)

# ---- group: UV Display
cluster_4 = Cluster(srf=srf_4, uv="0.15,0.15", vec_length=Slider(10, range=0..100))  # -> pt_2, vec_2, col_2
vdisex_3 = VectorDisplayEx(Point=cluster_4.pt_2, Vector=cluster_4.vec_2, Colour=cluster_4.col_2, Width=2)

# ----
stagqsubd_2 = StaggeredQuadSubD(Surface=srf_4, U=Slider(10, range=0..50), V=Slider(10, range=0..50))

# ---- group: UV Display
cluster_5 = Cluster(srf=srf_2, uv="0.15,0.15", vec_length=Slider(10, range=0..100))  # -> pt_2, vec_2, col_2
vdisex_4 = VectorDisplayEx(Point=cluster_5.pt_2, Vector=cluster_5.vec_2, Colour=cluster_5.col_2, Width=2)

# ---- group: Unify UVs with Guide Surfaces
unifybyguide_2 = UnifyUVsByGuideSrf(Breps=graft(brep_2), GuideSurface=graft(srf_5), Tolerance=num_2)

# ----
srf_6 = Surface(stagqsubd_2)

# ---- group: Unified Surfaces
srf_7 = Surface(unifybyguide_2)

# ---- group: UV Display - SEE CORRECT UV DIRECTIONS
cluster_6 = Cluster(srf=srf_7, uv="0.15,0.15", vec_length=Slider(10, range=0..100))  # -> pt_2, vec_2, col_2
vdisex_5 = VectorDisplayEx(Point=cluster_6.pt_2, Vector=cluster_6.vec_2, Colour=cluster_6.col_2, Width=2)

# ----
stagqsubd_3 = StaggeredQuadSubD(Surface=srf_7, U=Slider(4, range=0..10), V=Slider(6, range=0..10))

srf_8 = Surface(stagqsubd_3)

# ==== cluster Cluster
srf = ClusterInput()
uv = ClusterInput()
vec_length = ClusterInput()
srf_2 = Surface(srf)
uv_2 = Text(uv)
vec_length_2 = Number(vec_length)
evalsrf = EvaluateSurface(Surface=reparameterize(srf_2), Point=uv_2)  # -> Point, Normal, UDirection, VDirection, Frame
amp = Amplitude(Vector=evalsrf.UDirection, Amplitude=vec_length_2)
amp_2 = Amplitude(Vector=evalsrf.VDirection, Amplitude=vec_length_2)
amp_3 = Amplitude(Vector=evalsrf.Normal, Amplitude=vec_length_2)
merge = Merge(Data1=graft(amp), Data2=graft(amp_2), Data3=graft(amp_3))
merge_2 = Merge(
    Data1=ColourSwatch(SwatchColor=RGB(255, 0, 0)),
    Data2=ColourSwatch(SwatchColor=RGB(0, 255, 4)),
    Data3=ColourSwatch(SwatchColor=RGB(0, 115, 255)))
lng = ListLength(List=amp)
dup = DuplicateData(Data=graft(merge_2), Number=lng, Order=True)
flip = FlipMatrix(Data=dup)
pt = Point(graft(evalsrf.Point))
vec = Vector(merge)
col = Colour(flip)
pt_2 = ClusterOutput(pt)
vec_2 = ClusterOutput(vec)
col_2 = ClusterOutput(col)

# ==== cluster Cluster_2
geo = ClusterInput()
geo_2 = Geometry(geo)
bbox = BoundingBox(Content=geo_2, Plane=PlaneXY(0, 0, 0), UnionBox=False)  # -> graft(Box), Box_2
box_corners = BoxCorners(Box=bbox.Box)  # -> CornerA, CornerB, CornerC, CornerD, CornerE, CornerF, CornerG, CornerH
avr = Average(Input=[box_corners.CornerA, box_corners.CornerC])
dist = Distance(PointA=box_corners.CornerA, PointB=avr)
dist_2 = Distance(PointA=box_corners.CornerA, PointB=box_corners.CornerE)
cir = Circle(Plane=avr, Radius=dist)
Z = UnitZ(Factor=dist_2)
extr = Extrude(Base=cir, Direction=Z)
srf = Surface(extr)
srf_2 = ClusterOutput(srf)
