# Grasshopper definition 1.2_Util_TrimPanelsComponent.gh (Grasshopper 1.0.7)
# plug-ins: Ankylosaurus

# ---- group: Trimmed Srff
# RETRIM SURFACE AFTER UV ADJUSTMENT
# alanncation@gmail.com
# 
# Ways to use the Trim Panels Component.
srf = Surface(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)

# ---- group: UV Guide Srf
srf_2 = Surface(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)

# ----
# TRIM PANELS THEN SORT POINTS
srf_3 = Surface(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)

# ---- group: Input TRIMMED Srf
# TRIM PANELS AFTER SUBDIVIDING A TRIMMED SURFACE
srf_4 = Surface(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)

# ----
stagqsubd = StaggeredQuadSubD(Surface=srf_3, U=Slider(25, range=0..100), V=Slider(25, range=0..100))
number_slider = Slider(0.033, range=0..0.25)
subtraction = Subtraction(A="1", B=number_slider)
merge = Merge(Data1=number_slider, Data2=subtraction)
numsdivq = QuadSubdivideNumeric(Surface=reparameterize(stagqsubd), NumbersU=merge, NumbersV=merge)
srf_5 = Surface(flatten(numsdivq))

# ---- group: Tolerance - Adjust as needed
num = Number(Slider(0.8, range=0..1))

# ----
# Making the panels with any subdivision component will untrim Surfaces. We can use the panel trimmer to trim the panel surfaces to the original trimmed surface
number_slider_2 = Slider(25, range=0..100)

# ---- group: Make Panels
stagqsubd_2 = StaggeredQuadSubD(Surface=srf_4, U=number_slider_2, V=Slider(25, range=0..100))

# ---- group: Unify UVs with Guide Surfaces
# Unifying UVs will untrim the surface
unifybyguide = UnifyUVsByGuideSrf(Breps=graft(srf), GuideSurface=graft(srf_2), Tolerance=num)

# ---- group: TRIM PANELS COMPONENT
ptrim = TrimPanels(TrimSurface=srf_4, Panels=stagqsubd_2, InclusionOffset=0.5, Tolerance=0.01)

# We can use the trim panels component to retrim the surface!
ptrim_2 = TrimPanels(TrimSurface=srf, Panels=unifybyguide, InclusionOffset=0.5, Tolerance=0.01)

# ---- group: Trimmed with Correct UV orientation
srf_6 = Surface(ptrim_2)

# ---- group: TRIMMED PANELS!
srf_7 = Surface(ptrim)

# ---- group: TRIM PANELS COMPONENT
ptrim_3 = TrimPanels(TrimSurface=srf_3, Panels=srf_5, InclusionOffset=0.5, Tolerance=0.01)

# ---- group: UV Display - See Totally Messed Up UV Directions
panel = Panel("U = red // V = green // N = blue")
cluster = Cluster(srf=srf, uv="0.25,0.25", vec_length=Slider(10, range=0..100))  # -> pt_2, vec_2, col_2
vdisex = VectorDisplayEx(Point=cluster.pt_2, Vector=cluster.vec_2, Colour=cluster.col_2, Width=2)

# ---- group: UV Display - See Corrected
cluster_2 = Cluster(srf=srf_6, uv="0.5,0.5", vec_length=Slider(10, range=0..100))  # -> pt_2, vec_2, col_2
vdisex_2 = VectorDisplayEx(Point=cluster_2.pt_2, Vector=cluster_2.vec_2, Colour=cluster_2.col_2, Width=2)

# ----
srf_8 = Surface(ptrim_3)

area = Area(Geometry=srf_8, UseTasks=True)  # -> Area, Centroid
pt = Point(area.Centroid)
srf_9 = Surface(srf_8)
srf_cp = SurfaceClosestPoint(Point=pt, Surface=srf_9)  # -> Point, UVPoint, Distance
evalsrf = EvaluateSurface(Surface=srf_9, Point=srf_cp.UVPoint)  # -> Point, Normal, UDirection, VDirection, Frame
debrep = DeconstructBrep(Brep=srf_9)  # -> Faces, Edges, Vertices

# ----
# This sorts the points on a plane using a polar array. This is useful for certain geometric manipulations or taking panels from Grasshopper into Revit with Rhino Inside Revit for things like Adaptive Components, etc.
number_slider_3 = Slider(176, range=0..360)
pt_plnsort = SortPointsByPlane(Plane=graft(evalsrf.Frame), Points=debrep.Vertices, Angle=degrees(number_slider_3))

# ---- group: Angle Visual Check
pt_2 = Point(evalsrf.Point)
line = LineSDL(Start=pt_2, Direction=evalsrf.UDirection, Length=Slider(3.626, range=0..10))
rotate = Rotate(Geometry=line, Angle=degrees(number_slider_3), Plane=evalsrf.Frame)  # -> Geometry, Transform
line_2 = Line(rotate.Geometry)

# ---- group: Sorted Pts
pt_3 = Point(pt_plnsort)

# ----
scale = Scale(Geometry=pt_3, Center=graft(pt), Factor=0.75)  # -> Geometry, Transform
item = ListItem(List=pt_3, Index=0, Wrap=True)
points = PointList(Points=scale.Geometry, Size=Slider(0.283, range=0..1))

# ==== cluster Cluster
srf = ClusterInput()
uv = ClusterInput()
vec_length = ClusterInput()
srf_2 = Surface(srf)
uv_2 = Text(uv)
vec_length_2 = Number(vec_length)
evalsrf = EvaluateSurface(Surface=reparameterize(srf_2), Point=uv_2)  # -> Point, Normal, UDirection, VDirection, Frame
amp = Amplitude(Vector=evalsrf.UDirection, Amplitude=vec_length_2)
amp_2 = Amplitude(Vector=evalsrf.VDirection, Amplitude=vec_length_2)
amp_3 = Amplitude(Vector=evalsrf.Normal, Amplitude=vec_length_2)
merge = Merge(Data1=graft(amp), Data2=graft(amp_2), Data3=graft(amp_3))
merge_2 = Merge(
    Data1=ColourSwatch(SwatchColor=RGB(255, 0, 0)),
    Data2=ColourSwatch(SwatchColor=RGB(0, 255, 4)),
    Data3=ColourSwatch(SwatchColor=RGB(0, 115, 255)))
lng = ListLength(List=amp)
dup = DuplicateData(Data=graft(merge_2), Number=lng, Order=True)
flip = FlipMatrix(Data=dup)
pt = Point(graft(evalsrf.Point))
vec = Vector(merge)
col = Colour(flip)
pt_2 = ClusterOutput(pt)
vec_2 = ClusterOutput(vec)
col_2 = ClusterOutput(col)
