# Grasshopper definition 2.0_Form_BrepCells-RandomBoxes-Voxels.gh (Grasshopper 1.0.7)
# plug-ins: Ankylosaurus, ShapeDiverForGrasshopper

# alanncation@gmail.com
# 
# Ankylosaurus Form Component examples
sddp = ShapeDiverDocumentPayload({AbsoluteTolerance=0, AngleTolerance=0, DistanceDisplayPrecision=0, GltfVersion="Gltf2", GrasshopperVersion="1.0.0007", InputGroups="{}", OutputGroups="{}", RelativeTolerance=0, RhinoVersion="7.37.24107.15001", UnitSystem=0, VersionCreated="1.16.0.0", VersionSaved="1.16.0.0"})
# VOXELIZE MESH
xy = XYPlane(Origin=Point(0, 0, 0))
# VOXELIZE + RANDOM BOXES
xy_2 = XYPlane(Origin=Point(0, 0, 0))

# ---- group: Mesh to Voxelize
mesh = Mesh(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)

# RANDOM MODULAR BOXES ON FORM
mesh_2 = Mesh(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)

mesh_3 = Mesh(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)

# ---- group: Rotate Plane for desired Voxel Orientation
# This is not necessary, mostly just fun if you want voxels oriented different than XY
rotate = Rotate(Geometry=xy, Angle=degrees(Slider(-45, range=-100..100)), Plane=xy)  # -> Geometry, Transform
deplane = DeconstructPlane(Plane=rotate.Geometry)  # -> Origin, XAxis, YAxis, ZAxis
line = LineSDL(Start=deplane.Origin, Direction=deplane.XAxis, Length=1)
rotax = RotateAxis(Geometry=rotate.Geometry, Angle=degrees(Slider(45, range=0..100)), Axis=line)  # -> Geometry, Transform

# This is not necessary, mostly just fun if you want voxels oriented different than XY
rotate_2 = Rotate(Geometry=xy_2, Angle=degrees(Slider(45, range=-100..100)), Plane=xy_2)  # -> Geometry, Transform
deplane_2 = DeconstructPlane(Plane=rotate_2.Geometry)  # -> Origin, XAxis, YAxis, ZAxis
line_2 = LineSDL(Start=deplane_2.Origin, Direction=deplane_2.XAxis, Length=1)
rotax_2 = RotateAxis(Geometry=rotate_2.Geometry, Angle=degrees(Slider(60, range=0..100)), Axis=line_2)  # -> Geometry, Transform

# ----
popgeo = PopulateGeometry(Geometry=mesh_2, Count=Slider(1000, range=0..5000), Seed=1)
rndbox = ModularRandomBox(
    Planes=popgeo,
    MaxX=Slider(8, range=0..100),
    MaxY=Slider(5, range=0..100),
    MaxZ=Slider(20, range=0..100),
    ConstraintX=Slider(0.75, range=0..10),
    ConstraintY=Slider(1.5, range=0..10),
    ConstraintZ=Slider(3.25, range=0..10),
    Seed=Slider(666, range=0..1000))

pln = Plane(rotax.Geometry)
pln_2 = Plane(rotax_2.Geometry)

voxels = VoxelizeGeometry(Plane=pln, Mesh=mesh, X=Slider(2, range=0..10), Y=Slider(2.5, range=0..10), Z=Slider(4, range=0..10))  # -> VoxelBoxes, VoxelPlanes

voxels_2 = VoxelizeGeometry(Plane=pln_2, Mesh=mesh_3, X=Slider(2, range=0..10), Y=Slider(2.5, range=0..10), Z=Slider(4, range=0..10))  # -> VoxelBoxes, VoxelPlanes

pln_3 = Plane(voxels_2.VoxelPlanes)

# ---- group: Voxel Boxes
box = Box(voxels.VoxelBoxes)

# ---- group: Random Boxes
box_2 = Box(rndbox)

# ----
preview = CustomPreview(Geometry=box, Material=ColourSwatch(SwatchColor=RGB(135, 135, 135)))

preview_2 = CustomPreview(Geometry=box_2, Material=ColourSwatch(SwatchColor=RGB(135, 135, 135)))

rndbox_2 = ModularRandomBox(
    Planes=pln_3,
    MaxX=Slider(8, range=0..100),
    MaxY=Slider(10, range=0..100),
    MaxZ=Slider(12, range=0..100),
    ConstraintX=Slider(2, range=0..10),
    ConstraintY=Slider(2.5, range=0..10),
    ConstraintZ=Slider(4, range=0..10),
    Seed=Slider(666, range=0..1000))

# ---- group: Random Boxes
box_3 = Box(rndbox_2)

# ----
preview_3 = CustomPreview(Geometry=box_3, Material=ColourSwatch(SwatchColor=RGB(135, 135, 135)))

# ----
# BREP CELLS ON 3D VORONOI
number_slider = Slider(45, range=0..100)
number_slider_2 = Slider(1.605, range=0..10)
addition = Addition(A=number_slider, B=Slider(4, range=0..100))
dom = ConstructDomain(DomainStart=expr("-x/2", addition), DomainEnd=expr("x/2", addition))

# ---- group: Ankylosaurus - Modular Box
modbox = ModularBox(
    BasePlane=PlaneXY(0, 0, 0),
    DomainX=number_slider,
    DomainY=number_slider,
    DomainZ=number_slider,
    ConstraintX=number_slider_2,
    ConstraintY=number_slider_2,
    ConstraintZ=number_slider_2)

# ----
volume = Volume(Geometry=modbox, UseTasks=False)  # -> Volume, Centroid
pop3d = Populate3D(Region=modbox, Count=Slider(45, range=0..1000), Seed=1)

# ---- group: Ankylosaurus - Modular Box
modbox_2 = ModularBox(
    BasePlane=volume.Centroid,
    DomainX=dom,
    DomainY=dom,
    DomainZ=dom,
    ConstraintX=number_slider_2,
    ConstraintY=number_slider_2,
    ConstraintZ=number_slider_2)

# ----
voronoi³ = Voronoi3D(Points=pop3d, Box=modbox_2)  # -> Cells, Boundary

brep = Brep(voronoi³.Cells)

# ---- group: Ankylosaurus - BREP Cell
cell = BrepCell(Brep=brep, BrepScale=Slider(0.35, range=0..1), FaceScale=Slider(0.2, range=0..1))

# ----
brep_2 = Brep(cell)

edges = BrepEdges(Brep=brep_2)  # -> Naked, Interior, NonManifold
preview_4 = CustomPreview(Geometry=brep_2, Material=ColourSwatch(SwatchColor=RGB(135, 135, 135)))
preview_5 = CustomPreview(Geometry=[edges.Naked, edges.Interior], Material=ColourSwatch(SwatchColor=RGB(0, 0, 0)))
